# Grasshopper definition interpenetrated_spheres.gh (Grasshopper 1.0.7)
# Copyright: ©2018 GNU General Public License
# plug-ins: LunchBox, IntraLattice, TetgenGH

lattice = Lattice()  # Lattice curves to filter
crv = Curve(lattice)
curvepoint = PointOnCurve(crv, parameter=0.5)
panel = Panel("REMOVE DUPLICATE CURVES")
cullpt = CullDuplicates(Points=curvepoint, Tolerance="0.001", CullMode=1)  # -> Points, Indices, Valence
item = ListItem(List=crv, Index=cullpt.Indices, Wrap=True)
lattice_2 = Lattice(item)  # Filtered lattice

lattice_3 = Lattice()  # Lattice curves to filter
crv_2 = Curve(lattice_3)
curvepoint_2 = PointOnCurve(crv_2, parameter=0.5)
cullpt_2 = CullDuplicates(Points=curvepoint_2, Tolerance="0.001", CullMode=1)  # -> Points, Indices, Valence
item_2 = ListItem(List=crv_2, Index=cullpt_2.Indices, Wrap=True)
lattice_4 = Lattice(item_2)  # Filtered lattice

lattice_5 = Lattice()  # Lattice curves to filter
crv_3 = Curve(lattice_5)
curvepoint_3 = PointOnCurve(crv_3, parameter=0.5)
cullpt_3 = CullDuplicates(Points=curvepoint_3, Tolerance="0.001", CullMode=1)  # -> Points, Indices, Valence
item_3 = ListItem(List=crv_3, Index=cullpt_3.Indices, Wrap=True)
lattice_6 = Lattice(item_3)  # Filtered lattice

brep = Brep(<brep referenced from the Rhino model>)
bbox = BoundingBox(Content=brep, Plane=PlaneXY(0, 0, 0))  # -> Box, Box_2
rad = Radians(Degrees=Slider(0, range=0..360))
yz = YZPlane(Origin=Point(0, 0, 0))
boxprop = BoxProperties(Box=bbox.Box)  # -> Center, Diagonal, Area, Volume, Degeneracy
rotate = Rotate(Geometry=brep, Angle=rad, Plane=yz)  # -> Geometry, Transform
devec = DeconstructVector(Vector=boxprop.Diagonal)  # -> XComponent, YComponent, ZComponent
_2 = Number(2)
print_depth = Number(30)
division = Division(A=devec.YComponent, B=_2)
division_2 = Division(A=devec.XComponent, B=_2)
vec = VectorXYZ(XComponent=0, YComponent=0, ZComponent=0)  # -> Vector, Length
division_3 = Division(A=print_depth, B=devec.ZComponent)
move = Move(Geometry=rotate.Geometry, Motion=vec.Vector)  # -> Geometry, Transform
scale = Scale(Geometry=move.Geometry, Center=Point(0, 0, 0), Factor=division_3)  # -> Geometry, Transform
bbox_2 = BoundingBox(Content=scale.Geometry, Plane=PlaneXY(0, 0, 0))  # -> Box, Box_2
boxprop_2 = BoxProperties(Box=bbox_2.Box)  # -> Center, Diagonal, Area, Volume, Degeneracy
panel_4 = Panel(boxprop_2.Diagonal)
unit_cell_selector = CellSelector({"Prim. Cubic": 0, "BC": 1, "BC Cubic": 2, "FC Cubic": 3, "Edge Octa.": 4, "Vertex Octa.": 5, "NaCl": 6, "Star Tet.": 7, "BC Star Tet.": 8, "Octa. Tet.": 9, "Dodecahedron": 10, "Trunc. Octa.": 11, "Tetrahedral": 12, "BC1 (tween)": 13, "BC2 (tween)": 14, "Octa. (shell)": 15, "Dodeca. (shell)": 16, "Trunc. Octa. (shell)": 17, "Gyroid (shell)": 18, "Cubic Center": 19, "Cubic Face": 20}, selected="Prim. Cubic")
number_slider = Slider(6, range=0..10)
mesh = MeshBrep(
    Brep=scale.Geometry,
    Settings={GridMaxCount=0, GridMinCount=16, JaggedSeams=False, MaxEdgeLength=0, MinEdgeLength=0.0001, MinTolerance=0, Refine=True, RefineAngle=0, RelativeTolerance=0.65, SimplePlanes=True, Tolerance=0})
mshreduce = MeshReduce(Mesh=mesh, TargetSize=Slider(1200, range=0..2000), Distort=True, Accuracy=Slider(1, range=0..10), NormalizeSize=False)
voxelize = Voxelize(
    geometry=scale.Geometry,
    voxel_size_x=number_slider,
    voxel_size_y=number_slider,
    voxel_size_z=number_slider,
    fill_completely=Toggle(True))
cell_type = CellType(unit_cell_selector=unit_cell_selector)
cell_fill = CellFill(unit_cell=cell_type, voxels=voxelize)
colour = ColourPicker(PickedColour=RGB(0, 0, 255))
tetgen = Tetrahedralize(Mesh=mshreduce, Flags=Slider(1, range=0..5), MinRatio=Slider(2, range=0..5))  # -> Mesh, Indices, Points
trim_lattice = TrimLattice(geometry=scale.Geometry, lattice=cell_fill)  # -> trimmed_lattice, unrimmed_lattice
medges = MeshEdges(Mesh=tetgen.Mesh)  # -> NakedEdges, InteriorEdges, NonManifoldEdges
remove_by_valence = RemoveByValence(lattice=trim_lattice.unrimmed_lattice, valence_number=Slider(3, range=0..8))
merge_curves = MergeCurves(lattice=medges.InteriorEdges, max_distance=Slider(4, range=0..5))
preview = CustomPreview(Geometry=merge_curves, Material=colour)
morph_lattice_to_skin = MorphLatticeToSkin(
    lattice=remove_by_valence,
    geometry=tetgen.Mesh,
    max_distance=Slider(5, range=0..5),
    geometry_2=merge_curves,
    max_distance_2=Slider(5, range=0..5))
flatten = FlattenTree(Tree=morph_lattice_to_skin, Path="{0}")
merge = Merge(Data1=flatten, Data2=merge_curves)
merge_curves_2 = MergeCurves(lattice=merge, max_distance=Slider(5.5, range=0..10))
morph_lattice_to_skin_2 = MorphLatticeToSkin(lattice=merge_curves_2, geometry=brep, max_distance=Slider(0, range=0..5))
remove_duplicate_curves = RemoveDuplicateCurves(lattice=morph_lattice_to_skin_2)
homogen = Homogen(Struts=remove_duplicate_curves, Radius=Slider(0.3, range=0..5))
meshreport = MeshReport(Mesh=homogen)  # -> reverse(Report)
panel_5 = Panel(meshreport)
lattice_topology = LatticeTopology(lattice_beams=remove_duplicate_curves, tolerance=Slider(0.3, range=0..5))  # -> nodes, line_point_connections
tree2list = GhPythonScript(x=lattice_topology.line_point_connections)  # -> a; inputs x: tree
# ---------- tree2list: Python ----------
__author__ = "wyssuser"
__version__ = "2018.12.05"

import rhinoscriptsyntax as rs


a = []
for i in range(x.BranchCount):
    branchList = x.Branch(i)
    for j in range(0,branchList.Count,2):
        a.append([int(branchList[j]),int(branchList[j+1])])
# ---------- end tree2list ----------
panel_6 = Panel(lattice_topology.line_point_connections)
panel_7 = Panel(lattice_topology.nodes)
python = GhPythonScript(x=lattice_topology.nodes, y=tree2list)  # inputs x: list of Point3d, y: list
# ---------- python: Python ----------
__author__ = "wyssuser"
__version__ = "2018.12.05"

import rhinoscriptsyntax as rs

file_name = ghenv.Component.OnPingDocument().FilePath
edges = open(file_name+'_edges.csv','w')
vertices = open(file_name+'_vertices.csv','w')

for ind, pt in enumerate(x):
    vertices.write(str(pt)+'\n')
vertices.close()

for line in y:
    edges.write(str(line[0])+','+str(line[1])+'\n')
edges.close()
# ---------- end python ----------

# ==== cluster Voxelize: Fill a volume with uniform sized voxels

geometry = ClusterInput()  # Geometry to voxelize
voxel_size_x = ClusterInput()  # Voxel size int the X direction
voxel_size_y = ClusterInput()  # Voxel size int the Y direction
voxel_size_z = ClusterInput()  # Voxel size int the Z direction
fill_completely = ClusterInput()  # If true, Voxels will fill entire volume. If false, only Voxels with their centroid within the volume will be kept.
geo = Geometry(geometry)
num = Number(voxel_size_x)
num_2 = Number(voxel_size_y)
num_3 = Number(voxel_size_z)
bbox = BoundingBox(Content=geo, Plane=PlaneXY(0, 0, 0))  # -> Box, Box_2
boxprop = BoxProperties(Box=bbox.Box)  # -> Center, Diagonal, Area, Volume, Degeneracy
one_over_x = OneOverX(Value=num_2)
one_over_x_2 = OneOverX(Value=num)
one_over_x_3 = OneOverX(Value=num_3)
devec = DeconstructVector(Vector=boxprop.Center)  # -> XComponent, YComponent, ZComponent
multiplication = Multiplication(A=boxprop.Diagonal, B=one_over_x)
multiplication_2 = Multiplication(A=boxprop.Diagonal, B=one_over_x_2)
multiplication_3 = Multiplication(A=boxprop.Diagonal, B=one_over_x_3)
devec_2 = DeconstructVector(Vector=multiplication)  # -> XComponent, YComponent, ZComponent
devec_3 = DeconstructVector(Vector=multiplication_2)  # -> XComponent, YComponent, ZComponent
devec_4 = DeconstructVector(Vector=multiplication_3)  # -> XComponent, YComponent, ZComponent
expression = Expression(z=devec_4.ZComponent, Expression="ceiling(z)")
expression_2 = Expression(x=devec_3.XComponent, Expression="ceiling(x)")
expression_3 = Expression(y=devec_2.YComponent, Expression="ceiling(y)")
expression_4 = Expression(x=expression_2, u=num, a=devec.XComponent, Expression="-u*x/2+a")
expression_5 = Expression(y=expression_3, u=num_2, b=devec.YComponent, Expression="-u*y/2+b")
expression_6 = Expression(y=expression, u=num_3, b=devec.ZComponent, Expression="-u*y/2+b")
expression_7 = Expression(x=expression_2, Expression="x+1")
expression_8 = Expression(z=expression, Expression="z+1")
expression_9 = Expression(y=expression_3, Expression="y+1")
series = Series(Start=expression_4, Step=num, Count=expression_7)
series_2 = Series(Start=expression_6, Step=num_3, Count=expression_8)
series_3 = Series(Start=expression_5, Step=num_2, Count=expression_9)
# CRYSTALLON V1.0 -- Lattice structure tools for Grasshopper3D
# 
# Copyright (C) 2018  Aaron Porterfield
# 
# www.studiofathom.com
# www.fequalsf.com
# 
#     This program is free software: you can redistribute it and/or modify
#     it under the terms of the GNU General Public License as published by
#     the Free Software Foundation, either version 3 of the License, or any later version.
# 
#     This program is distributed in the hope that it will be useful,
#     but WITHOUT ANY WARRANTY; without even the implied warranty of
#     MERCHANTABILITY or FITNESS FOR A PARTICULAR PURPOSE.  See the
#     GNU General Public License for more details.
# 
#     You should have received a copy of the GNU General Public License
#     along with this program.  If not, see <http://www.gnu.org/licenses/>.
panel = Panel("VOXELIZE")
crossref = CrossReference(ListA=series, ListB=series_3, ListC=series_2, CrossMode=1)  # -> ListA, ListB, ListC
sort = SortList(Keys=[num, num_2, num_3])  # -> Keys, ValuesA
rev = ReverseList(List=sort.Keys)
pt = ConstructPoint(XCoordinate=crossref.ListA, YCoordinate=crossref.ListB, ZCoordinate=crossref.ListC)
item = ListItem(List=rev, Index=0, Wrap=True)
minc = MeshInclusion(Mesh=geo, Point=pt, Strict=False)
meshcp = MeshClosestPoint(Point=pt, Mesh=geo)  # -> Point, Index, Parameter
dist = Distance(PointA=pt, PointB=meshcp.Point)
expression_10 = Expression(a=item, d=dist, Expression="if(d<sqrt(2*(a/2)^2),True,False)")
cull = CullPattern(List=pt, CullPattern=minc)
cull_2 = CullPattern(List=pt, CullPattern=expression_10)
cull_3 = CullPattern(List=cull_2, CullPattern=fill_completely)
merge = Merge(Data1=cull, Data2=cull_3)
expression_11 = Expression(x=num_2, Expression="x/2")
expression_12 = Expression(x=num, Expression="x/2")
expression_13 = Expression(x=num_3, Expression="x/2")
cullpt = CullDuplicates(Points=merge, Tolerance=".001", CullMode=3)  # -> Points, Indices, Valence
box = CenterBox(Base=cullpt.Points, X=expression_12, Y=expression_11, Z=expression_13)
voxels = ClusterOutput(box)  # Voxels to be filled with unit cells

# ==== cluster CellType: Preset unit cells

crv = Curve([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])
crv_2 = Curve([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])
crv_3 = Curve([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])
crv_4 = Curve([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])
crv_5 = Curve([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])
crv_6 = Curve([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])
crv_7 = Curve([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])
crv_8 = Curve([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])
crv_9 = Curve([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])
crv_10 = Curve([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])
crv_11 = Curve([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])
crv_12 = Curve([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])
crv_13 = Curve([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])
crv_14 = Curve([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])
crv_15 = Curve([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])
mesh = Mesh(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)
mesh_2 = Mesh(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)
mesh_3 = Mesh(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)
mesh_4 = Mesh(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)
mesh_5 = Mesh(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)
mesh_6 = Mesh(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)
entwine = Entwine(
    Branch00=crv_6,
    Branch01=crv_10,
    Branch02=crv_13,
    Branch03=crv_4,
    Branch04=crv_2,
    Branch05=crv_8,
    Branch06=crv_11,
    Branch07=crv,
    Branch08=crv_7,
    Branch09=crv_9,
    Branch010=crv_12,
    Branch011=crv_3,
    Branch012=crv_5,
    Branch013=crv_14,
    Branch014=crv_15,
    Branch015=mesh,
    Branch016=mesh_2,
    Branch017=mesh_3,
    Branch018=mesh_4,
    Branch019=mesh_5,
    Branch020=mesh_6,
    FlattenInputs=True)  # -> simplify(Result)
unit_cell_selector = ClusterInput()
branch = TreeBranch(Tree=entwine, Path=unit_cell_selector, MaintainPaths=True)
unit_cell = ClusterOutput(branch)  # Single unit cell to populate voxels

# ==== cluster CellFill: Fill voxels with unit cells

unit_cell = ClusterInput()  # Unit cell to populate voxels
voxels = ClusterInput()  # Voxels to be filled with unit cells
crv = Curve(unit_cell)
bbox = BoundingBox(Content=crv, Plane=PlaneXY(0, 0, 0), UnionBox=True)  # -> Box, Box_2
panel = Panel("CELL FILL")
morph = BoxMorph(Geometry=crv, Reference=bbox.Box, Target=graft(voxels))  # -> flatten(Geometry)
remove_duplicate_lines = RemoveDuplicateLines(lattice_l=flatten(morph))
lattice = ClusterOutput(remove_duplicate_lines)  # List of curves that make up the lattice

# ==== cluster TrimLattice: Trim lattice with a closed volume

geometry = ClusterInput()  # Geometry to trim with (closed brep or mesh)
lattice = ClusterInput()  # Lattice curves to trim
geo = Geometry(geometry)
crv = Curve(lattice)
mesh = Mesh(geo)
mcx = MeshCurve(Mesh=mesh, Curve=crv)  # -> Points, Faces
null = NullItem(Item=mcx.Points)  # -> NullFlags, InvalidFlags, Description
crv_cp = CurveClosestPoint(Point=mcx.Points, Curve=graft(crv))  # -> Point, Parameter, Distance
panel = Panel("TRIM LATTICE")
cull = CullPattern(List=graft(crv), CullPattern=null.NullFlags)
shatter = Shatter(Curve=graft(crv), Parameters=crv_cp.Parameter)
curvepoint = PointOnCurve(cull, parameter=0.5)
curvepoint_2 = PointOnCurve(shatter, parameter=0.5)
minc = MeshInclusion(Mesh=mesh, Point=curvepoint, Strict=False)
minc_2 = MeshInclusion(Mesh=mesh, Point=curvepoint_2, Strict=False)
cull_2 = CullPattern(List=shatter, CullPattern=minc_2)
cull_3 = CullPattern(List=cull, CullPattern=minc)
crv_2 = Curve(flatten(cull_2))
crv_3 = Curve(flatten(cull_3))
unrimmed_lattice = ClusterOutput(crv_3)  # Lattice curves that have not been trimmed (Typically removes curves with valence 1)
trimmed_lattice = ClusterOutput(crv_2)  # Lattice curves that have been trimmed

# ==== cluster RemoveByValence: Remove curves by number of connections

lattice = ClusterInput()  # Lattice curves to filter
valence_number = ClusterInput()  # The number of connections each curve has
crv = Curve(lattice)
cp = ControlPoints(Curve=crv)  # -> Points, Weights, Knots
cps = ClosestPoints(Point=cp.Points, Cloud=flatten(cp.Points), Count=expr("x+1", valence_number))  # -> ClosestPoint, CPIndex, simplify(Distance)
panel = Panel("REMOVE BY VALENCE")
trim = TrimTree(Tree=cps.Distance, Depth=1)
ma = MassAddition(Input=trim)  # -> Result, PartialResults
smaller = SmallerThan(FirstNumber=ma.Result, SecondNumber="0")  # -> SmallerThan, OrEqualTo
cull = CullPattern(List=graft(crv), CullPattern=smaller.OrEqualTo)  # -> flatten(List)
lattice_2 = ClusterOutput(cull)  # Filtered lattice

# ==== cluster MorphLatticeToSkin: Morph lattice to connect to skin

geometry = ClusterInput()  # Geometry to morph to
lattice = ClusterInput()  # Lattice to morph to skin
geometry_2 = ClusterInput()  # Geometry to morph to
max_distance = ClusterInput()  # Maximum distance from geometry
max_distance_2 = ClusterInput()  # Maximum distance to moprh
geo = Geometry(geometry_2)
crv = Curve(lattice)
geo_2 = Geometry(geometry)
cp = ControlPoints(Curve=crv)  # -> simplify(Points), Weights, Knots
pull = PullPoint(Point=cp.Points, Geometry=geo_2, ClosestOnly=True)  # -> ClosestPoint, Distance
smaller = SmallerThan(FirstNumber=pull.Distance, SecondNumber=max_distance)  # -> SmallerThan, OrEqualTo
not = GateNot(A=smaller.SmallerThan)
cull = CullPattern(List=cp.Points, CullPattern=smaller.SmallerThan)
cull_2 = CullPattern(List=cp.Points, CullPattern=not)  # -> simplify(List)
pull_2 = PullPoint(Point=cull, Geometry=geo, ClosestOnly=True)  # -> simplify(ClosestPoint), simplify(Distance)
smaller_2 = SmallerThan(FirstNumber=pull_2.Distance, SecondNumber=max_distance_2)  # -> SmallerThan, OrEqualTo
not_2 = GateNot(A=smaller_2.SmallerThan)
panel = Panel("MORPH TO SKIN")
cull_3 = CullPattern(List=pull_2.ClosestPoint, CullPattern=smaller_2.SmallerThan)  # -> simplify(List)
cull_4 = CullPattern(List=cull, CullPattern=not_2)  # -> simplify(List)
merge = Merge(Data1=cull_2, Data2=cull_4, Data3=cull_3)
item = ListItem(List=merge, Index=0, Wrap=True)  # -> Item1, Item, Item1_2
ln = Line(StartPoint=item.Item1, EndPoint=item.Item)
remove_duplicate_lines = RemoveDuplicateLines(lattice_l=flatten(ln))
len = Length(Curve=remove_duplicate_lines)
larger = LargerThan(FirstNumber=len, SecondNumber=0)  # -> LargerThan, OrEqualTo
cull_5 = CullPattern(List=remove_duplicate_lines, CullPattern=larger.LargerThan)
crv_2 = Curve(cull_5)
lattice_2 = ClusterOutput(crv_2)  # Morphed lattice

# ==== cluster MergeCurves: Merge endpoints of curves by distance.

max_distance = ClusterInput()  # Maximum distance to merge
lattice = ClusterInput()  # Lattice to merge
crv = Curve(lattice)
num = Number(max_distance)
cp = ControlPoints(Curve=crv)  # -> Points, Weights, Knots
cullpt = CullDuplicates(Points=flatten(cp.Points), Tolerance=num, CullMode=3)  # -> Points, Indices, Valence
fsim = FindSimilarMember(Data=cp.Points, Set=cullpt.Points)  # -> Hit, Index
panel = Panel("MERGE CURVES")
pline = PolyLine(Vertices=fsim.Hit, Closed=False)  # -> flatten(Polyline)
len = Length(Curve=pline)
larger = LargerThan(FirstNumber=len, SecondNumber="0")  # -> LargerThan, OrEqualTo
cull = CullPattern(List=pline, CullPattern=larger.LargerThan)
lattice_2 = ClusterOutput(cull)  # Merged lattice

# ==== cluster LatticeTopology: Creates a clean graph of the lattice
tolerance = ClusterInput()  # Tolerance to merge points
lattice_beams = ClusterInput()  # Lattice Curves
num = Number(tolerance)
crv = Curve(lattice_beams)
cp = ControlPoints(Curve=crv)  # -> simplify(Points), Weights, Knots
cullpt = CullDuplicates(Points=flatten(cp.Points), Tolerance=num, CullMode=3)  # -> Points, Indices, Valence
sort_pt = SortPoints(Points=cullpt.Points)  # -> Points, Indices
fsim = FindSimilarMember(Data=cp.Points, Set=sort_pt.Points)  # -> Hit, simplify(Index)
panel = Panel("LATTICE TOPOLOGY")
pt = Point(sort_pt.Points)
num_2 = Number(fsim.Index)
nodes = ClusterOutput(pt)  # Unique points in the network
line_point_connections = ClusterOutput(num_2)  # Index of points that make up each beam

# ==== cluster RemoveDuplicateCurves: Remove curves that share the same midpoint

lattice = ClusterInput()  # Lattice curves to filter
crv = Curve(lattice)
curvepoint = PointOnCurve(crv, parameter=0.5)
panel = Panel("REMOVE DUPLICATE CURVES")
cullpt = CullDuplicates(Points=curvepoint, Tolerance="2.0", CullMode=1)  # -> Points, Indices, Valence
item = ListItem(List=crv, Index=cullpt.Indices, Wrap=True)
lattice_2 = ClusterOutput(item)  # Filtered lattice

# ==== cluster RemoveDuplicateLines
lattice_l = ClusterInput()
crv = Curve(lattice_l)
curvepoint = PointOnCurve(crv, parameter=0.5)
cullpt = CullDuplicates(Points=curvepoint, Tolerance=".001", CullMode=1)  # -> Points, Indices, Valence
item = ListItem(List=crv, Index=cullpt.Indices, Wrap=True)
lattice = ClusterOutput(item)
